# Grasshopper definition 041225_plaza full fabrication script (1).gh (Grasshopper 1.0.8)
# plug-ins: opennest_2 Info, OpenNest, Bifocals

no_katesh = Slider(21, range=0..100)
h_kati = Slider(4, range=0..10)

# ----
# DEFINING INPUTS
# DSC - Design Space
multiplication = Multiplication(A=h_kati, B=no_katesh)
top_height = Panel(multiplication)

r_kulles = Slider(10, range=0..100)
# ©CAAD_3.4
# THE PLAZA - FABRICATION MODEL
# Zero-Gravity Urbanism
# Plug-ins: 1- Open Nest / 2- EleFront
dif_r_baze_top = Slider(4.5, range=0..10)
addition = Addition(A=r_kulles, B=dif_r_baze_top)

# ---- group: Qendra Rrethore e Kulles
construct_point = ConstructPoint(XCoordinate=0, YCoordinate=0, ZCoordinate=0)

# ---- group: Qendra Poligonit te Tarraces
construct_point_2 = ConstructPoint(XCoordinate=0, YCoordinate=0, ZCoordinate=multiplication)

# ----
# sqarim: File i Rhino eshte i punuar ne Metra
link_tid_tower_drawings_reference = Panel("https://miesarch.com/work/3307")

sqarim = Panel("4 segmente = Katror")
seg_poligonit = Slider(5, range=0..10)

# ---- group: 2 profilet base-top
polygon = Polygon(Plane=construct_point_2, Radius=addition, Segments=seg_poligonit, FilletRadius=0)  # -> Polygon, Length
circle = Circle(Plane=construct_point, Radius=r_kulles)

# ----
spesori_max_i_fasades = Slider(1, range=1..1.5)
negative = Negative(Value=spesori_max_i_fasades)
offset_curve = OffsetCurve(Curve=circle, Distance=negative, Corners=1)

# ----
# Sqarim: Ne rast fabrikimi - ne shkalle 1:100 = 3mm (sa trashesia e materialit kompesates - pershtatemi me kushtet e fabrikimit beforehand)
paketa_e_soletes_trashesia_kompesates = Slider(0.3, range=0..1)

# ---- group: KUOTAT E SOLETAVE
series = Series(Start=0, Step=h_kati, Count=expr("x", no_katesh))
unit_z = UnitZ(Factor=series)

# ----
# Sqarim: DUHET TE JETE CIFT - Even numbers configuration of No. Slider
# 
# E plotespjestueshme me 4
# 
# Shmang probleme gjeometrike during explorative  iterative process
cps_per_soletat = Slider(52, range=0..100)

kuotat_pa_tarracen = Panel(series)

# ----
# 1st LOOSE END !!!!!
# BREP - Boundary Representation --> e njejte gjeometrikisht me polysurface ne rhino --> nuk krijon 1 siperfaqe te vazhduar, por disa.
# 
# Ne rastin tone, per arsye menaxhimi, na duhet te punojme idealisht me nje Surface Only.
loft = Loft(
    Curves=[polygon.Polygon, circle],
    Options={Adjust=False, Closed=False, LoftEnds=0, LoftSimp=0, LoftType=0, Rebuild=10, Refit=0.01})
panel = Panel(loft)

divide_curve = DivideCurve(Curve=offset_curve, Count=cps_per_soletat, Kinks=False)  # -> Points, Tangents, Parameters
divide_curve_2 = DivideCurve(Curve=circle, Count=cps_per_soletat, Kinks=False)  # -> Points, Tangents, Parameters

negative_2 = Negative(Value=Slider(1, range=0..10))
offset_curve_2 = OffsetCurve(Curve=offset_curve, Distance=negative_2, Corners=1)
divide_curve_3 = DivideCurve(Curve=offset_curve_2, Count=10, Kinks=False)  # -> Points, Tangents, Parameters

dispatch = Dispatch(List=divide_curve_2.Points, DispatchPattern=[True, False])  # -> ListA, ListB
dispatch_2 = Dispatch(List=divide_curve.Points, DispatchPattern=[True, False])  # -> ListA, ListB
shift_list = ShiftList(List=dispatch_2.ListB, Shift=Slider(-1, range=-1..0), Wrap=True)
line = Line(StartPoint=dispatch.ListA, EndPoint=shift_list)
line_2 = Line(StartPoint=dispatch.ListA, EndPoint=dispatch_2.ListB)

subtraction = Subtraction(A=h_kati, B=paketa_e_soletes_trashesia_kompesates)

# ---- group: poligon - multi segmented
curve = Curve(polygon.Polygon)

# ---- group: one single curve
curve_2 = Curve(circle)

# ----
as_much_as_possible_as_long_as_your_pc_d = Slider(1000, range=0..1000)  # "As much as possible, as long as your PC doesnt crash"
explode = Explode(Curve=curve, Recursive=True)  # -> Segments, Vertices
check = Panel(explode.Segments)
panel_2 = Panel("2")
rebuild_curve = RebuildCurve(Curve=[curve, curve_2], Degree=panel_2, Count=as_much_as_possible_as_long_as_your_pc_d, Tangents=False)
loft_2 = Loft(Curves=rebuild_curve, Options={Adjust=False, Closed=False, LoftEnds=0, LoftSimp=0, LoftType=0, Rebuild=10, Refit=0.01})

# ----
# KOLONAT
move = Move(Geometry=graft(divide_curve_3.Points), Motion=unit_z)  # -> Geometry, Transform
unit_z_2 = UnitZ(Factor=1)
line_sdl = LineSDL(Start=move.Geometry, Direction=unit_z_2, Length=subtraction)
pipe = Pipe(Curve=line_sdl, Radius=Slider(0.2, range=0..1), Caps=0)  # -> flatten(Pipe)

# ----
# 1st TRY
# ONE POSSIBLE SOLUTION --- transform the polygon into a nurbs curve
check_2 = Panel(curve_2)
check_3 = Panel(loft_2)

join_curves = JoinCurves(Curves=flatten([line, line_2]), Preserve=False)
flip_curve = FlipCurve(Curve=join_curves)  # -> Curve, Flag

negative_3 = Negative(Value=paketa_e_soletes_trashesia_kompesates)

unit_z_3 = UnitZ(Factor=1)
contour = Contour(Shape=loft_2, Point=construct_point, Direction=unit_z_3, Distance=h_kati)

# ---- group: Symmetric ADJUST - Optional Rotate
roating_angle_to_match_seams = Slider(13.845, range=0..100)
rotate = Rotate(Geometry=flip_curve.Curve, Angle=degrees(roating_angle_to_match_seams), Plane=PlaneXY(0, 0, 0))  # -> Geometry, Transform

# ----
rebuild_curve_2 = RebuildCurve(Curve=polygon.Polygon, Count=cps_per_soletat, Tangents=False)
loft_3 = Loft(
    Curves=flatten([rebuild_curve_2, rotate.Geometry]),
    Options={Adjust=False, Closed=False, LoftEnds=0, LoftSimp=0, LoftType=0, Rebuild=10, Refit=0.01})

negative_4 = Negative(Value=Slider(1, range=0..1))
offset_curve_3 = OffsetCurve(Curve=contour, Distance=negative_4, Corners=1)

# ----
# Discussion: Mistakes caused by Tweening Curve and Rebuild Operation VS Direct contours on the Generated Loft with the same amount of CPs
# SOLETAT
unit_z_4 = UnitZ(Factor=1)
contour_2 = Contour(Shape=loft_3, Point=construct_point, Direction=unit_z_4, Distance=h_kati)  # -> flatten(Contours)

unit_z_5 = UnitZ(Factor=negative_3)

surface = Surface(contour_2)
extrude = Extrude(Base=surface, Direction=unit_z_5)

# ----
# sqarim: -1 counts as last element of a list
first_element = Panel("0")
last_element = Panel("-1")
cull_index = CullIndex(List=contour_2, Indices=[first_element, last_element], Wrap=True)

explode_2 = Explode(Curve=cull_index, Recursive=True)  # -> Segments, Vertices

list_item = ListItem(List=contour_2, Index=last_element, Wrap=True)
explode_3 = Explode(Curve=list_item, Recursive=True)  # -> Segments, Vertices
dispatch_3 = Dispatch(List=simplify(explode_3.Segments), DispatchPattern=[True, False])  # -> ListA, ListB
curve_3 = Curve(dispatch_3.ListA)

dispatch_4 = Dispatch(List=simplify(explode_2.Segments), DispatchPattern=[True, False])  # -> ListA, ListB

curve_4 = Curve(dispatch_4.ListA)
curve_5 = Curve(dispatch_4.ListB)

trashesia_panelit_maket = Slider(0.2, range=0..1)
division = Division(A=trashesia_panelit_maket, B="2")
extend_curve = ExtendCurve(Curve=curve_4, Type=0, Start=expr("-X", division), End=expr("-X", "0"))
extend_curve_2 = ExtendCurve(Curve=curve_5, Type=0, Start=expr("-X", "0"), End=expr("-X", division))

# ---- group: BATCH-1
division_2 = Division(A=h_kati, B="2")
negative_5 = Negative(Value=negative_3)
unit_z_6 = UnitZ(Factor=division_2)
extrude_2 = Extrude(Base=extend_curve, Direction=unit_z_6)

# ---- group: TOP
curve_6 = Curve(dispatch_3.ListB)
unit_z_7 = UnitZ(Factor=division_2)
extrude_3 = Extrude(Base=curve_6, Direction=expr("-x", unit_z_7))

# ---- group: BATCH-2
unit_z_8 = UnitZ(Factor=expr("-x", division_2))
extrude_4 = Extrude(Base=extend_curve_2, Direction=unit_z_8)

# ----
unit_z_9 = UnitZ(Factor=negative_3)
move_2 = Move(Geometry=extrude_2, Motion=unit_z_9)  # -> Geometry, Transform

area = Area(Geometry=contour_2)  # -> Area, Centroid
trashesia_materialit_fasades_plexiglass = Slider(0.2, range=0..1)  # "Trashesia Materialit Fasades (Plexiglass 2mm)"

merge = Merge(Data1=extrude_3, Data2=move_2.Geometry, Data3=extrude_4)  # -> flatten(Result)

area_2 = Area(Geometry=merge)  # -> Area, Centroid

# ----
# FASADA
md_slider = MDSlider(SliderMode=0, slider_value=Point(0.5, 0.5, 0.5), x_domain=Domain(0, 1), y_domain=Domain(0, 1), z_domain=Domain(0, 1))

area_3 = Area(Geometry=contour_2)  # -> Area, Centroid
rectangle = Rectangle(Plane=area_3.Centroid, XSize="-4 to 4", YSize="-4 to 4", Radius=0)  # -> Rectangle, Length
cull_index_2 = CullIndex(List=rectangle.Rectangle, Indices="-1", Wrap=True)
subtraction_2 = Subtraction(A=h_kati, B=paketa_e_soletes_trashesia_kompesates)

evaluate_surface = EvaluateSurface(Surface=reparameterize(flatten(move_2.Geometry)), Point=md_slider)  # -> Point, Normal, UDirection, VDirection, Frame
multiplication_2 = Multiplication(A=evaluate_surface.Normal, B=trashesia_materialit_fasades_plexiglass)
extrude_5 = Extrude(Base=flatten(move_2.Geometry), Direction=expr("-X", multiplication_2))

evaluate_surface_2 = EvaluateSurface(Surface=reparameterize(flatten(extrude_4)), Point=md_slider)  # -> Point, Normal, UDirection, VDirection, Frame
multiplication_3 = Multiplication(A=evaluate_surface_2.Normal, B=trashesia_materialit_fasades_plexiglass)
extrude_6 = Extrude(Base=flatten(extrude_4), Direction=multiplication_3)

brep_wireframe = BrepWireframe(Brep=merge, Density=-1)
join_curves_2 = JoinCurves(Curves=brep_wireframe, Preserve=False)

evaluate_surface_3 = EvaluateSurface(Surface=reparameterize(extrude_3), Point=md_slider)  # -> Point, Normal, UDirection, VDirection, Frame
multiplication_4 = Multiplication(A=evaluate_surface_3.Normal, B=trashesia_materialit_fasades_plexiglass)
extrude_7 = Extrude(Base=flatten(extrude_3), Direction=expr("-X", multiplication_4))

unit_x = UnitX(Factor=1)
edges_from_directions = EdgesFromDirections(Brep=cull_index_2, Directions=unit_x, Reflex=True, Angle=0)  # -> Edges, Indices, Map
unit_y = UnitY(Factor=1)
edges_from_directions_2 = EdgesFromDirections(Brep=cull_index_2, Directions=unit_y, Reflex=True, Angle=0)  # -> Edges, Indices, Map

# ---- group: Garanton puthitjen
trashesia_e_materialit_fabrikimit = Panel("-0.3")
extend_curve_3 = ExtendCurve(
    Curve=edges_from_directions.Edges,
    Type=0,
    Start=trashesia_e_materialit_fabrikimit,
    End=trashesia_e_materialit_fabrikimit)

# ----
unit_z_10 = UnitZ(Factor=subtraction_2)
merge_2 = Merge(Data1=edges_from_directions_2.Edges, Data2=extend_curve_3)
extrude_8 = Extrude(Base=merge_2, Direction=unit_z_10)  # -> flatten(Extrusion)

x_dimension_of_a1_paper_size_in_cm_scale = Slider(59.4, range=0..100)  # "X dimension of A1 paper size in cm//scale 1:100"
y_dimension_of_a1_paper_size_in_cm_scale = Slider(84.1, range=0..100)  # "Y dimension of A1 paper size in cm//scale 1:100"
series_2 = Series(Start=0, Step=expr("x+5", y_dimension_of_a1_paper_size_in_cm_scale), Count=Slider(50, range=0..100))
construct_point_3 = ConstructPoint(XCoordinate=0, YCoordinate=series_2, ZCoordinate=0)
rectangle_2 = Rectangle(
    Plane=construct_point_3,
    XSize=x_dimension_of_a1_paper_size_in_cm_scale,
    YSize=y_dimension_of_a1_paper_size_in_cm_scale,
    Radius=0)  # -> Rectangle, Length

area_4 = Area(Geometry=merge)  # -> Area, Centroid
bounds = Bounds(Numbers=area_4.Area)
deconstruct_domain = DeconstructDomain(Domain=bounds)  # -> Start, End
gradient = Gradient(
    LowerLimit=deconstruct_domain.Start,
    UpperLimit=deconstruct_domain.End,
    Parameter=area_4.Area,
    stops=[0: RGB(0, 128, 0), 0.5: RGB(255, 255, 0), 1: RGB(255, 0, 0)])
custom_preview = CustomPreview(Geometry=merge, Material=gradient)

brep_wireframe_2 = BrepWireframe(Brep=extrude_8, Density=-1)
join_curves_3 = JoinCurves(Curves=brep_wireframe_2, Preserve=False)

# ---- group: Panele fasade 2D
curve_7 = Curve(flatten(join_curves_2))

# ---- group: Core Shkallesh Fabr.
curve_8 = Curve(flatten(join_curves_3))

# ---- group: Soletat 2D
curve_9 = Curve(contour_2)

# ----
# ANALYTICS
list_length = ListLength(List=area_4.Centroid)
series_3 = Series(Start=0, Step=1, Count=list_length)
text_tag = TextTag(Location=area_4.Centroid, Text=series_3)

project = Project(Polyline=curve_8)  # -> Polyline, Plane
pack_objects = PackObjects(Geo=curve_8, Plane=project.Plane, X=1, Y=1, Tolerance=0)  # -> Geo, Transformation

custom_preview_2 = CustomPreview(Geometry=[extrude_8, pipe], Material=ColourSwatch(SwatchColor=RGB(107, 100, 100)))

# ----
# VISUALIZATION
colour_swatch = ColourSwatch(SwatchColor=RGB(150, 132, 132))
custom_preview_3 = CustomPreview(Geometry=[extrude_7, extrude_6, extrude_5], Material=colour_swatch)

custom_preview_4 = CustomPreview(Geometry=extrude, Material=ColourSwatch(SwatchColor=RGB(201, 201, 201)))

opennest1 = OpenNest1(
    Sheets=rectangle_2.Rectangle,
    Geo=pack_objects.Geo,
    Spacing=1,
    Placement=1,
    Tolerance=0.1,
    Rotations=4,
    Iterations=1,
    Seed=1,
    Reset=True,
    Run=Toggle(True))  # -> Sheets, Geo, ID, Transform, IDS
area_5 = Area(Geometry=opennest1.Geo)  # -> Area, Centroid
text = Text(Location=area_5.Centroid, Text=opennest1.ID, Size=Slider(2, range=0..10))

length = Length(Curve=curve_8)
length_2 = Length(Curve=curve_7)
length_3 = Length(Curve=curve_9)
mass_addition = MassAddition(Input=flatten([length_2, length_3, length]))  # -> Result, PartialResults
# KPIs
nga_m_ne_cm = Slider(100, range=0..100)
division_3 = Division(A=mass_addition.Result, B=nga_m_ne_cm)
panel_3 = Panel(division_3)
round = Round(Number=division_3)  # -> Nearest, Floor, Ceiling
concatenate = Concatenate(Fragment_A=round.Ceiling, Fragment_B=" m/l", A=" prerje lazer")
panel_4 = Panel(concatenate)

merge_3 = Merge(Data1=text, Data2=opennest1.Geo, Data3=opennest1.Sheets)

leke_ml = Panel("30")
multiplication_5 = Multiplication(A=leke_ml, B=round.Ceiling)
concatenate_2 = Concatenate(FragmentA=multiplication_5, FragmentB=" leke")
panel_5 = Panel(concatenate_2)

# ----
# FABRIKIM
project_2 = Project(Polyline=curve_9)  # -> Polyline, Plane
opennest1_2 = OpenNest1(
    Sheets=rectangle_2.Rectangle,
    Geo=project_2.Polyline,
    Spacing=1,
    Placement=1,
    Tolerance=0.1,
    Rotations=4,
    Iterations=1,
    Seed=1,
    Reset=True,
    Run=invert(False))  # -> Sheets, Geo, ID, Transform, IDS
geometry = Geometry(opennest1_2.Geo)
area_6 = Area(Geometry=geometry)  # -> Area, Centroid
text_2 = Text(Location=area_6.Centroid, Text=opennest1_2.ID, Size=Slider(5, range=0..10))

project_3 = Project(Polyline=curve_7)  # -> Polyline, Plane; disabled
project_4 = Project(Polyline=curve_8)  # -> Polyline, Plane; disabled
project_5 = Project(Polyline=curve_9)  # -> Polyline, Plane; disabled
opennest = OpenNest(
    Sheets=rectangle_2.Rectangle,
    Geo=project_3.Polyline,
    Spacing=1,
    Placement=1,
    Tolerance=0.1,
    Rotations=4,
    Iterations=1,
    Seed=1,
    Reset=True,
    Run=False)  # -> Sheets, Geo, ID, Transform, IDS
opennest_2 = OpenNest(
    Sheets=rectangle_2.Rectangle,
    Geo=project_4.Polyline,
    Spacing=1,
    Placement=1,
    Tolerance=0.1,
    Rotations=4,
    Iterations=1,
    Seed=1,
    Reset=True,
    Run=False)  # -> Sheets, Geo, ID, Transform, IDS
opennest_3 = OpenNest(
    Sheets=rectangle_2.Rectangle,
    Geo=project_5.Polyline,
    Spacing=1,
    Placement=1,
    Tolerance=0.1,
    Rotations=4,
    Iterations=1,
    Seed=1,
    Reset=True,
    Run=False)  # -> Sheets, Geo, ID, Transform, IDS
