# Grasshopper definition plaza.gh (Grasshopper 1.0.8)

construct_point = ConstructPoint(XCoordinate=0, YCoordinate=0, ZCoordinate=0)
multiplication = Multiplication(A=Slider(40, range=0..100), B=Slider(35, range=0..100))
construct_point_2 = ConstructPoint(XCoordinate=0, YCoordinate=0, ZCoordinate=multiplication)
circle = Circle(Plane=construct_point, Radius=Slider(15, range=0..100))
offset_curve = OffsetCurve(Curve=circle, Distance=Slider(1.5, range=0..10), Corners=1)
polygon = Polygon(Plane=construct_point_2, Radius=Slider(30, range=0..100), Segments=Slider(4, range=0..10), FilletRadius=0)  # -> Polygon, Length
divide_curve = DivideCurve(Curve=offset_curve, Count=10, Kinks=False)  # -> Points, Tangents, Parameters
divide_curve_2 = DivideCurve(Count=10, Kinks=False)  # -> Points, Tangents, Parameters
dispatch = Dispatch(DispatchPattern=[True, False])  # -> ListA, ListB
