# Grasshopper definition script1.gh (Grasshopper 1.0.8)
# plug-ins: Human

no_katesh_boxet_brinja_1 = Slider(30, range=0..100)
nr_katesh_boxet_brinja_2 = Slider(32, range=0..100)
no_katesh_boxet_brinja_3 = Slider(30, range=0..100)

h_kati = Slider(5, range=0..10)
no_katesh_core = Slider(48, range=0..100)

# ----
# ATTENTION!!!
# CAAD 3.4
# Day_1
# Kick-Off
# RIKUJTESE: Instaloni PLUG-INS sipas udhezimeve ne Classroom, nen ME-MATERIALE ESENCIALE 01 (File GH + Plug-ins)
# Zero-Gravity Urbanism
# UDHEZIM: PER TE VIZUALIZUAR PJESE TE NDRYSHME TE PROCESIT, KUJTONI "HAPJEN DHE MBYLLJEN E SYVE", duke klikuar ne komponentin specifik, dhe me te djathten duke klikuar "Preview" ON/OFF
baza_core_kulla_x = Slider(32, range=0..100)
baza_core_kulla_y = Slider(51, range=0..100)

rectangle = Rectangle(Plane=PlaneXY(0, 0, 0), XSize=baza_core_kulla_x, YSize=baza_core_kulla_y, Radius=0)  # -> Rectangle, Length

# ----
# SHENIM. Pse /2?: Rikujtoni ne klase qe komanda Center Box, mqs. nis nga qendra, dhe si rrjedhoje X, Y dhe Z jane faktikisht dyfishi i vleres reale qe japim input tek X, Y apo Z. Pra nese dua nje box me dimensione 2x2x2, inputet duhet te jene 1x1x1. Per kete arsye, pjestojme me 2 vlerat, per te qene me koherent me inputet reale te perdorura.
panel = Panel("2")

multiplication = Multiplication(A=h_kati, B=no_katesh_core)
unit_z = UnitZ(Factor=multiplication)
extrude = Extrude(Base=rectangle.Rectangle, Direction=unit_z)

division = Division(A=no_katesh_boxet_brinja_1, B=panel)
division_2 = Division(A=nr_katesh_boxet_brinja_2, B=panel)
division_3 = Division(A=no_katesh_boxet_brinja_3, B=panel)
multiplication_2 = Multiplication(A=h_kati, B=division_2)
multiplication_3 = Multiplication(A=h_kati, B=division_3)
multiplication_4 = Multiplication(A=h_kati, B=division)
_1_2_brinjes_se_bazes_se_volumeve_te_sht = Slider(17, range=0..100)  # "1/2 brinjes se bazes se volumeve te shtuara"

unit_z_2 = UnitZ(Factor=1)
edges_from_directions = EdgesFromDirections(Brep=extrude, Directions=unit_z_2, Reflex=True, Angle=0)  # -> Edges, Indices, Map
list_item = ListItem(List=edges_from_directions.Edges, Index=0, Wrap=True)  # -> Item, Item1, Item2, Item3

# ----
# ADD-ONS 3rd AXIS
vlere_random_qe_shton_nr_e_kateve_tek_nj = Slider(13.5, range=0..100)  # "Vlere random qe shton nr. e kateve tek nje kub per te diversifikuar rezultatin"
point_on_curve = PointOnCurve(list_item.Item2, parameter=0.64)
addition = Addition(A=multiplication_3, B=vlere_random_qe_shton_nr_e_kateve_tek_nj)
center_box = CenterBox(Base=point_on_curve, X=_1_2_brinjes_se_bazes_se_volumeve_te_sht, Y=_1_2_brinjes_se_bazes_se_volumeve_te_sht, Z=addition)

# ----
# ADD-ONS 2nd AXIS
point_on_curve_2 = PointOnCurve(list_item.Item1, parameter=0.313)
point_on_curve_3 = PointOnCurve(list_item.Item1, parameter=0.894)
center_box_2 = CenterBox(
    Base=point_on_curve_2,
    X=_1_2_brinjes_se_bazes_se_volumeve_te_sht,
    Y=_1_2_brinjes_se_bazes_se_volumeve_te_sht,
    Z=multiplication_2)
center_box_3 = CenterBox(
    Base=point_on_curve_3,
    X=_1_2_brinjes_se_bazes_se_volumeve_te_sht,
    Y=_1_2_brinjes_se_bazes_se_volumeve_te_sht,
    Z=multiplication_2)

# ----
# ADD-ONS 1st AXIS
point_on_curve_4 = PointOnCurve(list_item.Item, parameter=0.268)
# NEW VOLUMES ADDING TO THE MAIN CORE
point_on_curve_5 = PointOnCurve(list_item.Item, parameter=0.788)
center_box_4 = CenterBox(
    Base=point_on_curve_5,
    X=_1_2_brinjes_se_bazes_se_volumeve_te_sht,
    Y=_1_2_brinjes_se_bazes_se_volumeve_te_sht,
    Z=multiplication_4)
center_box_5 = CenterBox(
    Base=point_on_curve_4,
    X=_1_2_brinjes_se_bazes_se_volumeve_te_sht,
    Y=_1_2_brinjes_se_bazes_se_volumeve_te_sht,
    Z=multiplication_4)

# ----
# ADD-ONS 4th AXIS
point_on_curve_6 = PointOnCurve(list_item.Item3, parameter=0.508)
center_box_6 = CenterBox(
    Base=point_on_curve_6,
    X=_1_2_brinjes_se_bazes_se_volumeve_te_sht,
    Y=_1_2_brinjes_se_bazes_se_volumeve_te_sht,
    Z=multiplication_3)

# ----
# MAIN STRUCTURAL CORE
cap_holes_ex = CapHolesEx(Brep=extrude)  # -> Brep, Caps, Solid

merge = Merge(
    Data1=center_box_4,
    Data2=center_box_5,
    Data3=center_box_2,
    Data4=cap_holes_ex.Brep,
    Data5=center_box_3,
    Data6=center_box_6,
    Data7=center_box)
solid_union = SolidUnion(Breps=flatten(merge))

# ----
# Vizualizim me transparence + Vizualizim i linjave nepermjet Plug-init "HUMAN"
colour_swatch = ColourSwatch(SwatchColor=RGBA(133, 133, 133, 48))
custom_preview = CustomPreview(Geometry=solid_union, Material=colour_swatch)

brep_wireframe = BrepWireframe(Brep=solid_union, Density=-1)
custom_preview_lineweights = CustomPreviewLineweights(
    Geometry=brep_wireframe,
    Shader=ColourSwatch(SwatchColor=RGB(0, 0, 0)),
    Thickness=Slider(2.8, range=0..10),
    Absolute=False)

construct_point = ConstructPoint(XCoordinate=0, YCoordinate=0, ZCoordinate=0)
unit_z_3 = UnitZ(Factor=1)
contour = Contour(Shape=solid_union, Point=construct_point, Direction=unit_z_3, Distance=h_kati)
join_curves = JoinCurves(Curves=contour, Preserve=False)  # -> flatten(Curves)

# ----
# SQARIM: Nuk arritem ta bejme ne klase, por Sort List, na mundeson rradhitjen e elementeve te nje liste "Values", nepermjet atributeve qe ne deshirojme ti rradhisim "Keys". Ne kete rast, jane marre pikat e qendres per cdo kat, dhe eshte bere e kunderta e "construct point", nepermjet komandes "Deconstruct point", e cila na zberthen pikat ne koordinata. Pra ne kete rast, sigurohemi qe pavaresisht ndryshimeve ne parametra dhe script, gjithmone katet te rradhiten sipas vleres se Z qe ato kane. Pra sipas lartesive te kateve. Kjo sepse, gjate scripteve, jo gjithmone ruhet hierarkia e te dhenave, ndaj na nevojiten keto "mekanizma" si SORT LIST.
# SORT LIST
area = Area(Geometry=flatten(join_curves))  # -> Area, Centroid
deconstruct = Deconstruct(Point=area.Centroid)  # -> XComponent, YComponent, ZComponent
sort_list = SortList(Keys=deconstruct.ZComponent, ValuesValuesA=join_curves)  # -> Keys, graft(ValuesValuesA)

# ----
# Vizualizimi i kateve me ngjyra sipas Siperfaqjes se cdo kati - (BLU, sip. e ulet - KUQE, sip. e larte)
# SQARIM: Gradienti funksionon ne baze te Domain te siperfaqjeve ne kete rast. Kjo do te thote se nepermjet "Bounds" (1) gjejme vlerat min dhe max te listes me vlera ne fjale, dhe "deconstruct domain" (2) na jep keto 2 vlera si outpute numerike te vecanta. Componenti "Gradient" ka nevoje per keto 2 limite (min, max), si dhe vleren e cdo siperfaqje kati, per te bere ngjyrosjen perkatese brenda ketyre limiteve.
surface = Surface(sort_list.ValuesValuesA)
area_2 = Area(Geometry=surface)  # -> Area, Centroid
bounds = Bounds(Numbers=flatten(area_2.Area))
deconstruct_domain = DeconstructDomain(Domain=bounds)  # -> Start, End
gradient = Gradient(
    LowerLimit=deconstruct_domain.Start,
    UpperLimit=deconstruct_domain.End,
    Parameter=flatten(area_2.Area),
    stops=[0: RGB(48, 18, 59), 0.0294: RGB(56, 40, 112), 0.0588: RGB(63, 62, 156), 0.0882: RGB(68, 82, 193), 0.118: RGB(70, 102, 221), 0.147: RGB(71, 122, 241)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])
custom_preview_2 = CustomPreview(Geometry=flatten(surface), Material=gradient)

# ----
# Shtrimi i Planeve - Per prerje lazer (maket potencial) - vetem kur kemi poligone planare / Soletat
# SQARIM: Nuk arritem ta bejme ne klase, por mund ti hidhni nje sy. Soletat jane projektuar te gjitha ne planin X,Y me Z=0. Mqs. ato mbivendosen, nepermjet Series, i kemi spostuar te gjitha si sekuence ne boshtin e X, ne menyre qe te jene te lexueshme.
project = Project(Geometry=sort_list.ValuesValuesA, Plane=PlaneXY(0, 0, 0))  # -> Geometry, Transform
number_slider = Slider(59, range=0..100)
list_length = ListLength(List=flatten(project.Geometry))
series = Series(Start=number_slider, Step=number_slider, Count=expr("x-1", list_length))  # -> graft(Series)
unit_x = UnitX(Factor=series)
move = Move(Geometry=project.Geometry, Motion=unit_x)  # -> Geometry, Transform
